# Grasshopper definition bowl.gh (Grasshopper 1.0.7)

z_height = Slider(-1, range=-5..20)
radius2 = Slider(3, range=-20..20)
radius1 = Slider(2, range=0..8)
xy_plane = XYPlane(Origin=Point(0, 0, 0))
arc_radius = Slider(-2, range=-5..20)
_0 = Integer(0)
vector_xyz = VectorXYZ(XComponent=radius1, YComponent=xy_plane, ZComponent=xy_plane)  # -> Vector, Length
circle = Circle(Plane=xy_plane, Radius=radius1)
vector_xyz_2 = VectorXYZ(XComponent=radius2, YComponent=_0, ZComponent=z_height)  # -> Vector, Length
vector_xyz_3 = VectorXYZ(XComponent=radius2, YComponent=_0, ZComponent=arc_radius)  # -> Vector, Length
arc_sed = ArcSED(Start=vector_xyz.Vector, End=vector_xyz_2.Vector, Direction=vector_xyz_3.Vector)  # -> Arc, Plane, Radius
vector_xyz_4 = VectorXYZ(XComponent=0, YComponent=0, ZComponent=Slider(-0.172, range=-1..1))  # -> Vector, Length
sweep1 = Sweep1(Rail=circle, Sections=arc_sed.Arc, Miter=1)
extrude = Extrude(Base=sweep1, Direction=vector_xyz_4.Vector)
