# Grasshopper definition cardboardClip.gh (Grasshopper 1.0.7)

curve = Curve(<curve referenced from the Rhino model>)
addition = Addition(A=2.4, B=Slider(1.786, range=0..4))
vector_xyz = VectorXYZ(XComponent=addition, YComponent=0, ZComponent=0)  # -> Vector, Length
linear_array = LinearArray(Geometry=curve, Direction=vector_xyz.Vector, Count=2)  # -> Geometry, Transform
multiplication = Multiplication(A=-0.5, B=addition)
vector_xyz_2 = VectorXYZ(XComponent=multiplication, YComponent=0, ZComponent=0)  # -> Vector, Length
move = Move(Geometry=linear_array.Geometry, Motion=vector_xyz_2.Vector)  # -> Geometry, Transform
polar_array = PolarArray(Geometry=move.Geometry, Plane=PlaneXY(0, 0, 0), Count=Slider(11, range=0..12), Angle=6.283185307)  # -> Geometry, Transform
solid_union = SolidUnion(Breps=polar_array.Geometry)
extrude = Extrude(Base=solid_union, Direction=Vector(0, 0, 3))
