# Grasshopper definition nestedCups.gh (Grasshopper 1.0.7)

number_slider = Slider(5, range=0..8)
curve = Curve(<curve referenced from the Rhino model>)
vector = Vector(Vector(0, 0, 0))
linear_array = LinearArray(Geometry=curve, Direction=vector, Count=number_slider)  # -> Geometry, Transform
series = Series(Start=1, Step=1, Count=number_slider)
scale = Scale(Geometry=linear_array.Geometry, Center=Point(0, 0, 0), Factor=series)  # -> graft(Geometry), Transform
offset_curve = OffsetCurve(Curve=scale.Geometry, Distance=Slider(1.2, range=0..1.2), Plane=PlaneXY(0, 0, 0), Corners=1)
merge = Merge(Data1=graft(scale.Geometry), Data2=offset_curve)
panel = Panel(merge)
boundary_surfaces = BoundarySurfaces(Edges=offset_curve)
boundary_surfaces_2 = BoundarySurfaces(Edges=merge)
extrude = Extrude(Base=boundary_surfaces_2, Direction=Vector(0, 0, 20))
extrude_2 = Extrude(Base=boundary_surfaces, Direction=Vector(0, 0, 1))
merge_2 = Merge(Data1=extrude, Data2=extrude_2)
panel_2 = Panel(merge_2)
solid_union = SolidUnion(Breps=merge_2)
